% Simulink data dictionary dictionary.sldd

Vb_bus = Simulink.Bus()
  w_b: double[3 1]
  vel_b: double[3 1]

Force = repmat(0, 6, 1)
Ic = [2 0 0; 0 5 0; 0 0 8]
m = 2
p_0 = 0
v_0 = [2 0 0]

Inertia_Vb = Simulink.Bus()
  Inertia_matrix: double[6 6]
  Vb: double[6 1]

R_p_Vb = Simulink.Bus()
  p: double[3 1]
  R: double[3 3]
  Vb: double[6 1]

w_0 = [0 0 0]